# Grasshopper definition form 778.gh (Grasshopper 1.0.7)

point = Point(Point(0, 0, 0))
point_2 = Point(Point(13.40667634, 3, 0))
rectangle_2pt = Rectangle2Pt(Plane=PlaneXY(0, 0, 0), PointA=point, PointB=point_2, Radius=0)  # -> Rectangle, Length
unit_z = UnitZ(Factor=Slider(15, range=0..30))
point_3 = Point(<point referenced from the Rhino model>)
point_4 = Point(<point referenced from the Rhino model>)
point_5 = Point(<point referenced from the Rhino model>)
point_6 = Point(<point referenced from the Rhino model>)
point_7 = Point(<point referenced from the Rhino model>)
point_8 = Point(<point referenced from the Rhino model>)
point_9 = Point(<point referenced from the Rhino model>)
point_10 = Point(<point referenced from the Rhino model>)
box_rectangle = BoxRectangle(Rectangle=rectangle_2pt.Rectangle, Height=unit_z)
sphere_4pt = Sphere4Pt(Point1=point_3, Point2=point_4, Point3=point_5, Point4=point_7)  # -> Center, Radius, Sphere
sphere_4pt_2 = Sphere4Pt(Point1=point_8, Point2=point_6, Point3=point_9, Point4=point_10)  # -> Center, Radius, Sphere
solid_difference = SolidDifference(BrepsA=box_rectangle, BrepsB=[sphere_4pt_2.Sphere, sphere_4pt.Sphere])
